# Grasshopper definition Intersection Test_2.gh (Grasshopper 0.9.76)
# plug-ins: Python Interpreter

srf_case1 = Surface([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])
srf_case2 = Surface([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])
srf_case3 = Surface([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])
srf_case4 = Surface([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])
spacing = Slider(0, range=0..4)
filter = StreamFilter(Gate=Slider(0, range=0..10), Stream0=srf_case1, Stream1=srf_case2, Stream2=srf_case3, Stream3=srf_case4)
create_cutsht = PythonScript(array=filter, spacing=spacing)  # -> out, a, b; inputs array: list of Surface
# ---------- create_cutsht: Python ----------
import Rhino.Geometry as rg
import rhinoscriptsyntax as rs

def list_to_tree(input, none_and_holes=True, source=[0]):
    """Transforms nestings of lists or tuples to a Grasshopper DataTree"""
    from Grasshopper import DataTree as Tree
    from Grasshopper.Kernel.Data import GH_Path as Path
    from System import Array
    def proc(input,tree,track):
        path = Path(Array[int](track))
        if len(input) == 0 and none_and_holes: tree.EnsurePath(path); return
        for i,item in enumerate(input):
            if hasattr(item, '__iter__'): #if list or tuple
                track.append(i); proc(item,tree,track); track.pop()
            else:
                if none_and_holes: tree.Insert(item,path,i)
                elif item is not None: tree.Add(item,path)
    if input is not None: t=Tree[object]();proc(input,t,source[:]);return t 

## returns an alinged plane at (U.5,V.5) of a planar surface
def set_base_plane(object):
    isPlanar = rg.PlaneSurface.TryGetPlane(object,.1)[0]
    if isPlanar == True:
        interval = rg.Interval(0.0,1.0)
        for i in range (2):
            object.SetDomain(i,interval)
        frame =  object.FrameAt(.5,.5)
        return frame[1]
    else: print "object is not a planar surface"
def generate_cut_sheet(stockOutline,partSpacing,numParts):
    
    pass

## performs a plane to plane reorient on an object w/ or w/out copying
def reorient_object(object,basePlane,targetPlane, copy = True):
    xform = rg.Transform.PlaneToPlane(source, target)
    if copy == True:
        xformObject = rs.CopyObject(object)
        xformObject.Transform(xform)
        return xformObject
    else:
        object.Transform(xform)
        return object

## returns a list of base planes aligned to objects in an array
def generate_base_planes_from_array(array):
    basePlanes = []
    for i in range(len(array)):
        part = array[i]
        basePlanes.append(set_base_plane(part))
    return basePlanes

b  = generate_base_planes_from_array(array)
# ---------- end create_cutsht ----------
create_slots = PythonScript(array=filter)  # -> out, a, b, c; inputs array: list of Brep
# ---------- create_slots: Python ----------
import rhinoscriptsyntax as rs


######################################################
## function should be imported as from ghutil library
def list_to_tree(input, none_and_holes=True, source=[0]):
    """Transforms nestings of lists or tuples to a Grasshopper DataTree"""
    from Grasshopper import DataTree as Tree
    from Grasshopper.Kernel.Data import GH_Path as Path
    from System import Array
    def proc(input,tree,track):
        path = Path(Array[int](track))
        if len(input) == 0 and none_and_holes: tree.EnsurePath(path); return
        for i,item in enumerate(input):
            if hasattr(item, '__iter__'): #if list or tuple
                track.append(i); proc(item,tree,track); track.pop()
            else:
                if none_and_holes: tree.Insert(item,path,i)
                elif item is not None: tree.Add(item,path)
    if input is not None: t=Tree[object]();proc(input,t,source[:]);return t            
## Finds intersections with a part and its neighbors
## returns a list of tuples with neighbor index and curve intersection 
def find_neighbor_intersections(arrayObjects,partIndex):
    intersections = []
    numItems = len(arrayObjects)
    if partIndex >= numItems:
        return "part index outside of array"
    part = arrayObjects[partIndex]
    #only searches neighbors indexed higher in the array
    for i in range (partIndex, numItems):
        neighbor = arrayObjects[i]
        intersectionTest = rs.IntersectBreps(part,neighbor)
        if intersectionTest != None:
            intersections.append((i,intersectionTest))
    # if there are no intersections alert the user
    if len(intersections) == 0:
        return "this part does not intersect with its neighbors"
    else:
        return intersections

## returns a point on a curve given a normalized parameter
def evaluateCrv (crv,normalizedParameter):
    crvParam = rs.CurveParameter(crv,normalizedParameter)
    crvPt = rs.EvaluateCurve(crv,crvParam)
    return crvPt

## creates half-lap slots for a given part with its intersecting neighbors
## returns a list of tuples with part index and slot curve 
def create_slots (arrayObjects,partIndex):
    numItems = len(arrayObjects)
    if partIndex >= numItems:
        return "part index outside of array"
    part = arrayObjects[partIndex]
    intersections = find_neighbor_intersections(arrayObjects,partIndex)
    boundary = rs.DuplicateSurfaceBorder(part)
    slots = []
    ## check intersections with the part's boundary to determine joint case
    ## rs.CurveCurveIntersection returns case specific lists see F1 help.
    for line in intersections:
        if len(line) == 1: return
        intersectTest = rs.CurveCurveIntersection(line[1],boundary)
        ## Case 1: slot is floating in part boundary (Only works in some cases)
        if intersectTest == None:
            slots.append((partIndex,line[1]))
        ## Case 2: intersection coincedent along an edge and can't be slotted 
        elif intersectTest[0][0] == 2:
            print "no slot needed"
        ## Case 3: part and neighbor have a valid connection and slot is drawn
        else:    
            ## create Current Part slot
            startPoint = intersectTest[0][1]
            endPoint = evaluateCrv(line[1],.5)
            slot = rs.AddLine(startPoint,endPoint)
            slots.append((partIndex,slot))
            ## create neighbor slot
            testPoint = rs.CurveEndPoint(line[1])
            distance = rs.Distance(startPoint,testPoint)
            if distance != 0:
                startPoint = testPoint
            else:
                startPoint = rs.CurveStartPoint(line[1])
            slot = rs.AddLine(startPoint,endPoint)
            slots.append((line[0],slot))
    return slots
## creates slots for all items in an array
## returns a 2D list with slots grouped by part
def create_all_slots (arrayobjects):
    numItems = len(arrayobjects)
    slotCollection =[[] for i in range(numItems)]
    for i in xrange (numItems):
        print "partIndex", i
        currentSlots = create_slots(arrayobjects,i)
        print "current slots", currentSlots
        if currentSlots != None:
            for slot in currentSlots:
                slotCollection[slot[0]].append(slot[1])
    return slotCollection
######################################################
e = create_all_slots (array)
a = list_to_tree(e)
# ---------- end create_slots ----------
crv = Curve(simplify(create_slots.a))
pt = Point(create_slots.c)
pln = Plane(create_cutsht.b)
branch = TreeBranch(Tree=crv, Path=Slider(1, range=0..10), MaintainPaths=True)
panel = Panel(branch)
viewer = ParamViewer(crv)
panel_2 = Panel(create_slots.out)
