# Grasshopper definition MocapDemo-garthz.gh (Grasshopper 0.9.76)
# plug-ins: Python Interpreter

# ----
# Mocap Stream Receiver
# Note that the input Planes are rotated
# from Optitrack XZ ground plane convention
#  to Rhino XY ground plane conventions.
toggle = BooleanToggle(False)
timer = Timer(TimerInterval=50, Target=mocapreceiver)  # disabled
mocapreceiver = PythonScript(reset=toggle, version="2800")  # -> out, received, names, planes; inputs reset: Boolean
# ---------- mocapreceiver: Python ----------
# MocapReceiver.py - the motion capture script in the ghpython object in MocapDemo.gh

# Demonstration of receiving and parsing an Optitrack motion capture real-time stream.
# This is normally polled from a timer.
#
# inputs
#   reset   - Boolean flag to reset the receiver system
#   version - string defining the protocol version number (e.g. "2900" for Motive 1.9)
#
# outputs
#   out      - debugging text stream
#   received - integer number of new frames received
#   planes   - list of Plane objects or None, one per rigid body stream

# use persistent state context
import scriptcontext

# import the Optitrack stream receiver
# reload(optirecv)
import optirecv

# If the user reset input is set, then clear any existing state and do nothing.
if reset:
    print "Resetting receiver state."
    scriptcontext.sticky['mocap_port'] = None
 
else:
    # fetch or create the persistent motion capture streaming receiver port
    port = scriptcontext.sticky.get('mocap_port')
    if port is None:
        port = optirecv.OptitrackReceiver(version)
        scriptcontext.sticky['mocap_port'] = port

    # Poll the port as long as data is available, accumulating all
    # frames.  It is unlikely that Grasshopper will keep up with the
    # 120 Hz mocap sampling rate, butit is important to have the
    # continuous trajectory available for analysis and recording.
    receiving = True
    frames = list()
    while receiving:
        receiving = port.poll()
        if receiving:
            frames.append(port.make_plane_list())

    # Convert the frame list into a data tree for output.  As accumulated, it is a Python list of lists:
    # [[body1_sample0, body2_sample0, body3_sample0, ...], [body1_sample1, body2_sample1, body3_sample1, ...], ...]
    planes = optirecv.frames_to_tree(frames)
    received = len(frames)
    
    # Emit the list of body names in the order corresponding to the
    # branches in the trajectory data tree.  The ordering is stable as
    # determined by the configuration in the Motive project.
    names  = port.bodynames
# ---------- end mocapreceiver ----------
panel = Panel(mocapreceiver.out)
panel_2 = Panel(mocapreceiver.received)
panel_3 = Panel(mocapreceiver.names)
panel_4 = Panel(mocapreceiver.planes)

# ----
# Mocap CSV File Loader
# jitterbug
# parallels
# media lab
# Note: the Mocap CSV loader rotates
# the input data from the XZ ground plane
# convention of the Optitrack system
# to a XY Rhino ground plane convention.
path = FilePath("C:\Users\garthz\src\cmuphyscomp\hmv-s16\debugging\mocapdata\gesture flicks with head tracking 2016-02-23 03.39.22 PM.csv")
path_2 = FilePath("C:\cygwin\home\garthz\src\cmuphyscomp\hmv-s16\debugging\mocapdata\gesture flicks with head tracking 2016-02-23 03.39.22 PM.csv")
path_3 = FilePath("C:\cygwin\home\garthz\src\cmuphyscomp\hmv-s16\debugging\mocapdata\gesture flicks with head tracking 2016-02-23 03.39.22 PM.csv")
stride = Slider(1, range=1..20)
panel_5 = Panel(path)
csv_loader = PythonScript(path=panel_5, stride=stride)  # -> out, names, planes
# ---------- csv_loader: Python ----------
# CSVLoader.py - the file loader script in the ghpython object in MocapDemo.gh.

# Demonstration of parsing an Optitrack motion capture CSV file.
#
# inputs
#   path    - string with the full path to the CSV file
#   stride  - the sequence interval between successive points; 1 returns all points, >1 subsamples
#
# outputs
#   out      - debugging text stream
#   names    - data tree of body names
#   planes   - data tree of Plane trajectories, one branch per rigid body, each leaf a list of Planes

# import the Optitrack file loader from the same folder
import optiload

# load the file
take = optiload.load_csv_file(path)

print "Found rigid bodies:", take.rigid_bodies.keys()

# emit all return values
names = take.rigid_bodies.keys()
planes = optiload.all_Planes(take, int(stride))
# ---------- end csv_loader ----------
panel_6 = Panel(csv_loader.planes)
panel_7 = Panel(csv_loader.out)
panel_8 = Panel(csv_loader.names)
viewer = ParamViewer(csv_loader.planes)

# ----
# Mocap CSV File Player:
# stream trajectory segments
# to simulate live input
# select segment from
# full tree from file
# playback group size
rewind_playback = Button()
enable_playback = BooleanToggle(True)
size = Slider(12, range=1..20)
branch = TreeBranch(Tree=csv_loader.planes, Path="{0;0}", MaintainPaths=True)
lng = ListLength(List=branch)
timer_2 = Timer(TimerInterval=100, Target=counter)  # disabled
counter = PythonScript(name="playback_counter", enable=enable_playback, reset=rewind_playback, low=0, high=lng, step=size)  # -> out, value; inputs enable: Boolean, reset: Boolean, low: Int32, high: Int32, step: Int32
# ---------- counter: Python ----------
# Counter.py - general purpose counter block for use in ghpython object
# inputs
#  name   - counter name token string
#  enable - bool to enable counting
#  reset  - bool to reset to lowest value
#  low    - lowest output value
#  high   - upper bound on output value
#  step   - interval to step

# outputs
#   value - integer count value

import scriptcontext as sc

value = sc.sticky.get(name)

if value is None or reset or value >= high:
    value = low

elif enable:
    value = value + step

sc.sticky[name] = value
print value
# ---------- end counter ----------
subtraction = Subtraction(A=size, B=1)
int = Integer(counter.value)
addition = Addition(A=int, B=subtraction)
panel_9 = Panel(int)
dom = ConstructDomain(DomainStart=int, DomainEnd=addition)
subset = SubList(List=csv_loader.planes, Domain=dom, Wrap=False)  # -> List, Index
trim = TrimTree(Tree=subset.List, Depth=1)
panel_10 = Panel(trim)
viewer_2 = ParamViewer(trim)

# ----
# Select input source
# and divide trajectory streams
# divide mocap trajectory branches
# by body name in alphabetical order;
# this reduces dependence on the
# rigid body definition ordering.
# Select mocap data source:
# 0 for streaming, 1 for file
# separate mocap stream by body
# Cursor
# Gesture
# Tool
number_slider = Slider(0, range=0..1)
filter = StreamFilter(Gate=number_slider, Stream0=mocapreceiver.planes, Stream1=trim)
filter_2 = StreamFilter(Gate=number_slider, Stream1=csv_loader.planes)
filter_3 = StreamFilter(Gate=number_slider, Stream0=mocapreceiver.names, Stream1=csv_loader.names)
panel_11 = Panel(filter_3)
sortedpaths = PythonScript(names=filter_3)  # -> out, paths, p1, p2, p3, p4; inputs names: list
# ---------- sortedpaths: Python ----------
# SortedPaths.py - contents of the ghpython object
# inputs
#  names - list of body names from a mocap stream

# outputs
#  paths - list of data tree paths in order sorted by name
#  Pn    - individual path

sorted_names = sorted(names)
indices = [names.index(name) for name in sorted_names]
paths = ["0;%d" % index for index in indices]

p1 = paths[0]
p2 = paths[1]
p3 = paths[2]
p4 = paths[3]
# ---------- end sortedpaths ----------
panel_12 = Panel(sortedpaths.paths)
branch_2 = TreeBranch(Tree=filter, Path=sortedpaths.p1, MaintainPaths=True)
branch_3 = TreeBranch(Tree=filter, Path=sortedpaths.p2, MaintainPaths=True)
branch_4 = TreeBranch(Tree=filter, Path=sortedpaths.p3, MaintainPaths=True)
branch_5 = TreeBranch(Tree=filter, Path=sortedpaths.p4, MaintainPaths=True)
viewer_3 = ParamViewer(branch_2)
viewer_4 = ParamViewer(branch_3)
viewer_5 = ParamViewer(branch_5)
# Head
viewer_6 = ParamViewer(branch_4)

# ----
# Display full Gesture track from file
item = ListItem(List=sortedpaths.paths, Index=1, Wrap=True)
branch_6 = TreeBranch(Tree=filter_2, Path=item, MaintainPaths=True)
deplane = DeconstructPlane(Plane=branch_6)  # -> Origin, XAxis, YAxis, ZAxis
multiplication = Multiplication(A=deplane.YAxis, B=0.2)
addition_2 = Addition(A=deplane.Origin, B=multiplication)
pt = Point(addition_2)
ln = Line(StartPoint=deplane.Origin, EndPoint=addition_2)

panel_13 = Panel(branch_2)
number_slider_2 = Slider(0.1, range=0..0.1)
pt_2 = Point(Point(-0.003541303518, -0.9895634437, 0))
tag = TextTag3D(
    Location=Plane(origin=(-0.6076364688, 0.9994886447, 0), x=(0.9944432973, 0.1052735882, 0), y=(-0.00247008597, 0.02333311212, 0.9997246944)),
    Text="I am a tag",
    Size=number_slider_2,
    Justification=7)
aligndim = AlignedDimension(
    Plane=PlaneXY(0, 0, 0),
    PointA=Point(0, 0.007129006801, 1.56539629),
    PointB=Point(0, 0.00619624192, 1.629757067),
    Offset=1,
    Text="{0:0.00}",
    Size=number_slider_2)
# tag at point, always oriented to viewport
tag_2 = TextTag(Location=pt_2, Text="I am a tag")
markdim = MarkerDimension(Line=Line((0, -0.2753207357, 0.16009398), (0, 0.7584075754, 0.5101744943)), Text="I am a tag", Size=number_slider_2)

# ----
# show Cursor
# trajectory
xy = XYPlane(Origin=Point(0, 0, 0))
srf = Surface(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)
orient = Orient(Geometry=srf, Source=xy, Target=branch_2)  # -> Geometry, Transform
col = Colour(RGB(0, 194, 13))
preview = CustomPreview(Geometry=orient.Geometry, Shader=col)

# ----
# Gesture Event Detection
# Detect quick flicking motions
# acceleration threshold
# (smaller is more sensitive)
deplane_2 = DeconstructPlane(Plane=branch_3)  # -> Origin, XAxis, YAxis, ZAxis
threshold = Slider(126, range=100..300)
multiplication_2 = Multiplication(A=deplane_2.YAxis, B=0.2)
reset_gestures = Button()
addition_3 = Addition(A=deplane_2.Origin, B=multiplication_2)
ln_2 = Line(StartPoint=deplane_2.Origin, EndPoint=addition_3)
pt_3 = Point(addition_3)
detectflick = PythonScript(reset=reset_gestures, points=pt_3, threshold=threshold)  # -> out, sample, pos, accel; inputs points: list of Point3d
# ---------- detectflick: Python ----------
# DetectFlick.py - contents of the ghpython object in MocapDemo.gh
#
# inputs
#   reset   - Boolean to deactivate and reset state
#   points  - list of Point3D objects representing the path of the tip of an indicating stick
#             Note: the 'points' input must be set to 'List Access'
# threshold - the acceleration value above which to output an event

# outputs
#   out      - debugging text stream
#   sample   - None, or an integer sample offset for the flick event; zero is 'now', negative values are relative to now.
#   pos      - list of points in buffer
#  accel     - list of estimated accelerations

# use persistent state context
import scriptcontext
sc_identifier = 'flick_detector'

# use point filter with acceleration estimator
# reload(pointfilter)
import pointfilter

# If the user reset input is set, then clear any existing state and do nothing.
if reset:
    print "Resetting receiver state."
    scriptcontext.sticky[sc_identifier] = None 

else:
    # fetch or create the persistent filter object
    filter = scriptcontext.sticky.get(sc_identifier)
    if filter is None:
        filter = pointfilter.Point3dFilter(80)
        scriptcontext.sticky[sc_identifier] = filter
        
    # add the new data
    filter.add_points(points)
    # print filter._position
    # print "Adding %d points to filter." % len(points)
    # offset, mag, acc, pos = filter.find_accel_peak()
    # print "Peak at %d of %f" % (offset, mag)
    
    sample = filter.detect_acceleration_event( threshold )
    if sample is not None:
        print "Acceleration peak observed at %d" % sample
    
    print "Filter has seen %d points, buffer starts at %d, blanking ends at %d." % (filter.samples, filter.samples - filter._buf_len, filter.last_event + filter.blanking)
    pos = filter._position
    accel = filter._accel
# ---------- end detectflick ----------
panel_14 = Panel(detectflick.out)
panel_15 = Panel(detectflick.sample)

# ----
# show Tool
# trajectory
cone = Cone(Base=PlaneXY(0, 0, 0), Radius=0.1, Length=0.2)  # -> Cone, Tip
xy_2 = XYPlane(Origin=Point(0, 0, 0))
orient_2 = Orient(Geometry=cone.Cone, Source=xy_2, Target=branch_4)  # -> Geometry, Transform

item_2 = ListItem(List=branch_2, Index=-1, Wrap=True)
item_3 = ListItem(List=branch_2, Index=-2, Wrap=True)
# compute cursor velocity
xy_3 = XYPlane(Origin=Point(0, 0, 0))
orient_3 = Orient(Geometry=xy_3, Source=item_2, Target=item_3)  # -> Geometry, Transform
# number of cards
# naming convention
panel_16 = Panel("{0}")
button = Button()
subtraction_2 = Subtraction(A="52", B=1)
dom_2 = ConstructDomain(DomainStart=1, DomainEnd="52")

# ----
# Record Indicated Poses
# show indicated poses
clear_poses = Button()
planerecord = PythonScript(inputs=branch_2, capture=detectflick.sample, clear=clear_poses)  # -> out, planes; inputs inputs: list of Plane, capture: Int32, clear: Boolean
# ---------- planerecord: Python ----------
# PlaneRecord.py - the plane data recording script in the ghpython object in MocapDemo.gh.
#
# inputs
#  inputs   - list of Plane objects
#  capture  - None or integer sample time offset indicating which recent object should be added to the set
#  clear    - Boolean indicating the the data set should be erased
#  N.B. the 'inputs' input must be set to 'List Access'
#  N.B. the 'capture' input should have a type hint of Int

# other ideas:
#   path       - string with the full path to the CSV file
#   selection  - currently selected set

# outputs
#   out      - debugging text stream
#   planes   - list of Plane objects

# use RhinoCommon API
import Rhino

# use persistent state context
import scriptcontext

# use the history utility class
import historybuffer

################################################################
class PlaneRecorder(object):
    def __init__(self):
        # list of selected objects
        self.planes = []
 
        # keep track of about a quarter-second of mocap data
        self.buffer = historybuffer.History(30)
        return

    def add_planes(self, planes):
        if planes is not None:
            self.buffer.append(planes)
        return
    
    def capture_plane(self, offset):
        self.planes.append(self.buffer[offset])
        return

################################################################
if clear:
    # create an empty data recorder
    recorder = PlaneRecorder()
    scriptcontext.sticky['plane_recorder'] = recorder

else:
    # fetch or create a persistent data recorder
    recorder = scriptcontext.sticky.get('plane_recorder')
    if recorder is None:
        recorder = PlaneRecorder()
        scriptcontext.sticky['plane_recorder'] = recorder
    recorder.add_planes(inputs)

if capture is not None:
    # The capture index is non-positive: zero means 'now', negative means a recent sample.  So the value is
    # biased by -1 to be an index relative to the end of the recorded poses.
    recorder.capture_plane(capture-1)
 
planes = recorder.planes
print "Buffer has seen %d planes, currently holding %d selected planes." % (recorder.buffer.samples, len(planes))
# ---------- end planerecord ----------
pln = Plane(planerecord.planes)
xy_4 = XYPlane(Origin=Point(0, 0, 0))
panel_17 = Panel(planerecord.out)
srf_2 = Surface(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)
orient_4 = Orient(Geometry=srf_2, Source=xy_4, Target=pln)  # -> Geometry, Transform
panel_18 = Panel(pln)
col_2 = Colour(RGB(255, 0, 255))
preview_2 = CustomPreview(Geometry=orient_4.Geometry, Shader=col_2)

range = Range(Domain=dom_2, Steps=subtraction_2)
format = Format(Format=panel_16, Culture=127, Data0=range)

# ----
# Editor Logic
# add new objects to document
# set object selection
# objects must appear on named layer
# write transformed objects back to document
set_selection = Button()
selectedgeometry = PythonScript(layer="Cards", update=set_selection)  # -> out, geom, guid
# ---------- selectedgeometry: Python ----------
# SelectedGeometry.py - contents of the SelectedGeometry ghpython script

# inputs
#   layer  - string naming the layer to address within the current Rhino document
#  update  - any input will force recomputing the output (dummy value)

# outputs
#   out    - console debugging output
#   geom   - list of geometry primitives currently selected in the layer
#   guid   - list of GUID strings for the geometry primitives
#
# Note: the GUIDs are for objects located in the RhinoDoc database, *not* the
# Grasshopper document database, so they are only useful for requesting updates
# to the current Rhino document.

import Rhino
import System.Guid
import pythonlibpath; pythonlibpath.add_library_path()
import ghutil.ghrhinodoc as ghrhinodoc

# Fetch the layer index, creating the layer if not present.
layer_name = str(layer)
layer_index = ghrhinodoc.fetch_or_create_layer_index(layer_name)

# Fetch all objects on the layer, choose the selected ones,  and report out individual properties.
# See the definition of RhinoObject.IsSelected; if the argument is true then it also reports on sub-objects.
all_objects = ghrhinodoc.all_doc_objects(layer_name)
selected_objects = [obj for obj in all_objects if obj.IsSelected(False) > 0] 

print "Found %d objects in layer, %d are selected." % (len(all_objects), len(selected_objects))

geom = [obj.Geometry for obj in selected_objects]
guid = [str(obj.Id) for obj in selected_objects]
# ---------- end selectedgeometry ----------
panel_19 = Panel(selectedgeometry.geom)
panel_20 = Panel(selectedgeometry.guid)
panel_21 = Panel(selectedgeometry.out)
srf_3 = Surface(selectedgeometry.geom)
edit_mode = Slider(4, range=1..4)
update_document = Button()
abandon_edits = Button()
gesturelogic = PythonScript(
    name="move_logic",
    reset=Toggle(False),
    gesture=detectflick.sample,
    cursor=branch_2,
    poses=pln,
    mode=edit_mode,
    update=update_document,
    selection=srf_3,
    selguids=selectedgeometry.guid,
    setselect=set_selection,
    clear=abandon_edits,
    layer_name="Cards",
    all_names=format,
    create_interval=Slider(5, range=1..20))  # -> out, add, move, names, newloc, status, objects, guids, xform; inputs cursor: list, poses: list, mode: Int32, selection: list of Surface, selguids: list, all_names: list
# ---------- gesturelogic: Python ----------
# GestureLogic - state machine for interface logic for the gesture-based editing.
#
# This encompasses all the logic for the editor which is easier to write in
# Python than Grasshopper objects.  Only one GestureLogic instance is expected to
# exist since it holds and tracks user inputs.
#
# Objectives for this block:
#
# 1. Only hold transient user state.  All persistent data is read from the
#    RhinoDoc, manipulated in a transient way, and then written back to the
#    RhinoDoc or discarded.
#
# 2. Emit signals to read and write the model rather than directly manipulate
#    the RhinoDoc.  This does increase the number of I/O variables, but
#    is intended to make the operation easier to observe, debug, and extend.
# 
# inputs:
#  name    - name token string for sticky
#  reset   - bool to reset to lowest value
#  gesture - None or relative sample index (integer) of detected gesture event
#  cursor  - list of Planes with recent cursor object trajectory
#  poses   - list of Planes saved at gesture events
#  mode
#  update
#  selection
#  selguids
#  setselect
#  clear
#  all_names
#  layer_name  - name of the editable layer in the RhinoDoc
#  create_interval - integer number of cycles between creating new objects

# Note: the following must have 'List Access' set: cursor, poses, selection, selguids, all_names
#
# outputs:
#  out    - log string output for display; the log is persistent to reduce the amount of flickering
#  add
#  move
#  names
#  newloc
#  status
#  objects
#  guids
#  xform

################################################################
import scriptcontext as sc
import clr
import System.Guid
import math

import Rhino
import pythonlibpath; pythonlibpath.add_library_path()
import ghutil.ghrhinodoc as ghrhinodoc

################################################################
class EditorLogic(object):
    """Utility class to manage the state of the interactive editor."""

    def __init__(self, _layer_name = 'Cards', _all_names = []):
        self.layer_name = _layer_name
        self._last_setselect = False # debounce variable
        self.attached = False
        self.interval_counter = 0
        self.mocap_dt = 1.0 / 120 # sampling rate of the motion capture stream

        # list of strings in which to accumulate messages for output
        self.log       = ["Editor initialized for layer %s." % self.layer_name]    
         
        # initialize the default sets of object names based on those found on the RhinoDoc layer
        self._update_namesets(_all_names)
        
        # freshly created objects: poses and names
        self.new_object_poses = list()
        self.new_object_names = list()

        # the current selection
        self.selection = None
        self.docguids = None
        self.selection_bb = None
        self.selection_bb_size = None
        
        # coordinate transformation for group edits
        self.transform = None  
        self.motion    = None
        self.xforms    = []    # list of transforms, one per selected object
        
        return

    def add_new_object_pose(self, plane):   
        if plane is not None:
            name = self.choose_new_name()
            if name is not None:
                self.new_object_poses.append(plane)
                self.new_object_names.append(name)
        return
        
    def clear_edits(self):
        """Reset all transient editor state, either at user request or after editing cycle is complete."""
        self.new_object_poses = list()
        self.new_object_names = list()
        self.attached = False
        self.selection = None
        self.docguids = None
        return

    def logprint(self, msg):
        self.log.append(msg)
        
    def clear_log(self):
        self.log = []
        
    def set_namesets(self, all_names, used_names):
        """Update the name manager given a list of all possible object names and the list of object names currently in use."""
        self.all_names = set(all_names)
        self.used_names = set()
        
        # check for duplicate names
        for used in used_names:
            if used in self.used_names:
                self.logprint("Warning: object name %s appears more than once." % used)
            else:
                self.used_names.add(used)
                
        # check for used names not listed in the all_names set
        invalid_names = self.used_names - self.all_names
        if invalid_names:
            self.logprint("Warning: invalid names in use: %s" % invalid_names)
            
        # compute the list of available names
        self.unused_names = self.all_names - self.used_names
        self.logprint("Found the following unused object names: %s" % self.unused_names)
        return

    def choose_new_name(self):
        """Pick an name arbitrarily from the set of unused names."""
        if len(self.unused_names) == 0:
            self.logprint("Warning: no more object names available.")
            return None
        # return new names in numerical order for clarity
        new_name = sorted(self.unused_names)[0]
        self.unused_names.remove(new_name)
        return new_name

    def _update_namesets(self, all_names):
        all_objects = ghrhinodoc.all_doc_objects(layer_name)        
        names = [obj.Attributes.Name for obj in all_objects]
        self.set_namesets(all_names, names)
        return
  
    def _compute_set_bounding_box(self, selection):
        if selection is None or len(selection) == 0:
            return None
            
        # compute bounding box for all objects in a set
        boxes = [obj.GetBoundingBox(True) for obj in selection]

        # compute union of all boxes
        union = boxes[0]
        # destructively merge this with the other boxes
        for b in boxes[1:]:
            union.Union(b)
        return union, union.Diagonal.Length


    def manage_user_selection(self, setselect, selection, selguids, all_names):
        """Process the user 'Set Selection' input, updating the editor state for any new
        objects and names as needed."""
        
        if setselect != self._last_setselect:
            # debounce input to just trigger once
            self._last_setselect = setselect
            if setselect == True:
                self.selection = selection
                self.docguids = selguids
                
                self.selection_bb, self.selection_bb_size = self._compute_set_bounding_box(selection)
                self.logprint("Updated selection bounding box to %s, diagonal size %f" % (self.selection_bb, self.selection_bb_size))

                # reset the pick and place state
                self.attached  = False
                self.transform = None
                self.xforms    = []

                self.logprint("Selection set with %d objects." % len(selection))
                self._update_namesets(all_names)
                
    #================================================================
    def read_objects_from_layer(self, layer_name):
        """Read the user-visible names of all objects on a specific RhinoDoc layer.
        Returns a tuple (geoms, guids, names) with lists of all geometry
        objects, RhinoDoc GUID strings, and name attributes.
        """
        layer_index = ghrhinodoc.fetch_or_create_layer_index(layer_name)

        # Fetch all objects on the layer and report out individual properties.
        all_objects = ghrhinodoc.all_doc_objects(layer_name)

        geoms = [obj.Geometry for obj in all_objects]
        guids = [str(obj.Id) for obj in all_objects]
        names = [obj.Attributes.Name for obj in all_objects]
        return geoms, guids, names

    #================================================================
    def update_tap_create_mode(self, gesture, cursor, update, clear):
        """Update state for the 'tap create' mode in which gestures create individual cards.
        gesture - the integer gesture sample index or None
        cursor  - the list of recent cursor poses

        returns newloc, names, add
        """

        # default outputs
        names, add = None, None
        
        # tap create mode: each gesture creates a new object
        if gesture is not None:
            self.logprint("Gesture detected with sample offset %d." % gesture)
            # gesture is an integer sample where zero is the most recent pose;
            # index the current cursor poses from the end to select the correct
            # pose
            self.add_new_object_pose(cursor[gesture-1])

        if clear == True:
            self.logprint( "Abandoning editor changes (dropping new object poses).")
            self.clear_edits()         

        # by default, always emit the new poses so they can be visualized
        newloc = self.new_object_poses

        if update == True:
            self.logprint("Writing new objects to RhinoDoc: %s" % self.new_object_names)
            names = self.new_object_names
            add = True
            self.clear_edits() # note: the current list has already been emitted, this just resets the buffer

        return newloc, names, add
        
    #================================================================
    def update_path_create_mode(self, _gesture, _cursor, _update, _clear, _all_names, _create_rate):

        """Update state for the 'symbol sprayer' mode which places new objects along a
        cursor path.  Each gesture event toggles the creation events on or off.

        returns newloc, names, add
        """

        # default outputs
        names, add = None, False
        
        # detect the singular gesture events (for now, a flick of the wand)
        if _gesture is not None:
            if self.attached:
                self.logprint("Creation path ended.")
            else:
                self.logprint("Creation path beginning.")
                self.interval_counter = 0
                self._update_namesets(_all_names)
                
            # toggle the 'attached' state
            self.attached = not self.attached

        # while 'attached' to the sprayer, create new objects at regular intervals
        if self.attached:
            self.interval_counter += 1
            
            if self.interval_counter > _create_rate:
               self.interval_counter = 0
               self.add_new_object_pose(_cursor[-1])

        if _clear == True:
            self.logprint( "Abandoning editor changes (dropping new object poses).")
            self.clear_edits()         

        # by default, always emit the new poses so they can be visualized
        newloc = self.new_object_poses

        if _update == True:
            self.logprint("Writing new objects to RhinoDoc: %s" % self.new_object_names)
            names = self.new_object_names
            add = True
            self.clear_edits() # note: the current list has already been emitted, this just resets the buffer

        return newloc, names, add
        
    #================================================================
    def update_block_move_mode(self, gesture, cursor, poses, update, clear):
        """Update state for the 'block move' mode in which each gesture alternately
        attaches or detaches the selection from the cursor.

        returns objects, guids, xform, move
        """

        # set default outputs
        objects = self.selection
        guids = self.docguids
        move = False
        
        motion = Rhino.Geometry.Transform(1) # motion transform is identity value by default

        if clear == True:
            self.logprint("Abandoning editor changes (clearing movement).")
            self.transform = None
            
        # detect the singular gesture events (for now, a flick of the wand)
        if gesture is not None:
            # if we are ending a motion segment, save the most recent transformation as the new base transform
            if self.attached:
                self.transform = self.transform * self.motion
                self.logprint("Motion ended, new transform saved.")
            else:
                self.logprint("Motion beginning.")
                
            # toggle the 'attached' state
            self.attached = not self.attached
            
        if self.attached:
            if len(poses) > 0 and len(cursor) > 0:
                # compute a tranform the from most recent saved pose to the newest cursor position
                motion = Rhino.Geometry.Transform.PlaneToPlane(poses[-1], cursor[-1])
        
        # compute an output transformation from the accumulated transform plus any transient movement
        if self.transform is None:
            self.transform = Rhino.Geometry.Transform(1) # identity
        xform = self.transform * motion
        self.motion = motion

        if update == True:
            self.logprint("Updating RhinoDoc selection with new poses.")
            move = True
            self.clear_edits()

        return objects, guids, xform, move

    #================================================================
    def update_path_move_mode(self, gesture, cursor, poses, update, clear):
        """Update state for the 'path move' mode in which each gesture toggles the
        enable, and the cursor velocity affects object positions within a 'brush'
        radius.

        returns objects, guids, xform, move
        """

        # set default outputs
        objects = self.selection
        guids = self.docguids
        move = False
        
        delta = Rhino.Geometry.Transform(1) # motion transform is identity value by default

        # FIXME: this is probably moot
        if self.transform is None:
            self.transform = Rhino.Geometry.Transform(1) # identity

        if self.selection is not None and (self.xforms is None or len(self.xforms) != len(self.selection)):
            self.xforms = [Rhino.Geometry.Transform(1) for x in self.selection]
            
        if clear == True:
            self.logprint("Abandoning editor changes (clearing movement).")
            self.transform = Rhino.Geometry.Transform(1)
            
        # detect the singular gesture events (for now, a flick of the wand)
        if gesture is not None:
            # if we are ending a motion segment
            if self.attached:
                self.logprint("Motion deactivated.")
            else:
                self.logprint("Motion activated.")
                
            # toggle the 'attached' state
            self.attached = not self.attached
            
        if self.attached:
            if len(cursor) > 1 and cursor[-1] is not None and cursor[-2] is not None:
                # Compute separate translation and rotation thresholds to
                # determine whether the velocity is high enough to be a gesture.

                # Find the rotation and translation between the last pair of samples:
                rot = Rhino.Geometry.Quaternion.Rotation(cursor[-2], cursor[-1])
                delta = cursor[-1].Origin - cursor[-2].Origin
                displacement = delta.Length

                # Convert the rotation to axis-angle form to find the magnitude.  The function uses C# call by reference to return
                # the parameters as 'out' values:
                angle = clr.Reference[float]()
                axis  = clr.Reference[Rhino.Geometry.Vector3d]()
                rot.GetRotation(angle, axis)
                angle = angle.Value # get rid of the StrongBox around the number
                axis  = axis.Value  # get rid of the StrongBox around the vector

                # The angle is returned on (0,2*pi); manage the wraparound
                if angle > math.pi:
                    angle -= 2*math.pi
                    
                # normalize to a velocity measure: m/sec, radians/sec
                speed = displacement / self.mocap_dt
                omega = angle / self.mocap_dt
                
                # compute object to cursor distances
                boxes = [obj.GetBoundingBox(False) for obj in self.selection]
                center = cursor[-1].Origin 
                distances = [box.Center.DistanceTo(center) for box in boxes]
                
                # Apply thresholds to determine whether the gesture represents intentional motion:
                if speed > 1.0 and True:
                    self.transform = self.transform * Rhino.Geometry.Transform.Translation(delta)
                    
                if abs(omega) > 2.0 and True:
                    # self.logprint("detected motion on speed %f and angular rate %f" % (speed, omega))
                    # apply the movement to the output tranform
                    # FIXME: transform should be a list, one per object, selective via a spherical cursor                                       
                    # choose a specific method from the set of overloaded signatures
                    Rotation_Factory = Rhino.Geometry.Transform.Rotation.Overloads[float, Rhino.Geometry.Vector3d, Rhino.Geometry.Point3d]
                    rot_xform = Rotation_Factory(angle, axis, center)
                    self.transform = self.transform * rot_xform
                    
                    # Apply a weighted displacement to each object transform.  The scaling matches the rolloff of the 
                    # effect to be proportional to the size of the bounding box of the moving objects.
                    scale = 0.1 * self.selection_bb_size * self.selection_bb_size
                    weights = [min(1.0, scale/(dist*dist)) if dist > 0.0 else 1.0 for dist in distances]
                    # self.logprint("Weights: %s" % (weights,))
                    rotations = [Rotation_Factory(angle*weight, axis, center) for weight in weights]
                    self.xforms = [xform*rot for xform,rot in zip(self.xforms, rotations)]

        if update == True:
            self.logprint("Updating RhinoDoc selection with new poses.")
            move = True
            self.clear_edits()

        return objects, guids, self.xforms, move


################################################################
# create or re-create the editor state as needed
editor = sc.sticky.get(name)
if editor is None or reset:
    editor = EditorLogic('Cards', all_names)
    sc.sticky[name] = editor

# set default output values
add    = False
move   = False
names  = None
newloc = None
objects = None
guids   = None
xform   = None

if reset:
    print "Interaction logic in reset state."
    status = "Reset"
    
else:
    # for all modes, record the set of selected objects when indicated
    editor.manage_user_selection(setselect, selection, selguids, all_names)

    # handle the state update for each individual mode
    if mode == 1:
        newloc, names, add = editor.update_tap_create_mode(gesture, cursor, update, clear)

    elif mode == 2:
        newloc, names, add = editor.update_path_create_mode(gesture, cursor, update, clear, all_names, create_interval)
        
    elif mode == 3:
        objects, guids, xform, move = editor.update_block_move_mode(gesture, cursor, poses, update, clear)

    elif mode == 4:
        objects, guids, xform, move = editor.update_path_move_mode(gesture, cursor, poses, update, clear)
        
    # emit terse status for remote panel
    status = "M:%s C:%d P:%d N:%d" % (editor.attached, len(cursor), len(poses), len(editor.new_object_poses))

    # re-emit the log output
    for str in editor.log: print str
# ---------- end gesturelogic ----------
transform = Transform(Geometry=gesturelogic.objects, Transform=gesturelogic.xform)
panel_22 = Panel(gesturelogic.status)
srf_4 = Surface(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)
orient_5 = Orient(Geometry=srf_4, Source=PlaneXY(0, 0, 0), Target=gesturelogic.newloc)  # -> Geometry, Transform
col_3 = Colour(RGB(230, 216, 25))
col_4 = Colour(RGB(255, 170, 0))
panel_23 = Panel(gesturelogic.out)
replacegeometry = PythonScript(layer="Cards", update=gesturelogic.move, guids=gesturelogic.guids, gobjs=transform)  # -> out, newids; inputs guids: list, gobjs: list
# ---------- replacegeometry: Python ----------
# ReplaceGeometry.py - contents of the ReplaceGeometry ghpython script
#
# inputs
#   layer  - string naming the layer to address within the current Rhino document
#  update  - Boolean indicating the action is enabled
#   guids  - list of GUID strings identifying a single object within the RhinoDoc to replace
#   gobjs  - equal-length list of geometry objects to add, either a raw Geometry type or a ghdoc GUID
#
# Note: guids and gobjs must be set to 'List Access'
#
# outputs
#   out    - console debugging output
#  newids  - list of GUID strings for the new geometry primitive
#
# Note: the GUIDs are for objects located in the RhinoDoc database, *not* the
# Grasshopper document database, so they are only useful for requesting updates
# to the current Rhino document.

# Note: the new object Name attributes are copied from the objects to be deleted so they persist.  This could
# be extended to other user-specified properties if desired.

import Rhino
import System.Guid
import pythonlibpath; pythonlibpath.add_library_path()
import ghutil.ghrhinodoc as ghrhinodoc

if update and guids is not None:
    # Fetch the layer index, creating the layer if not present.
    layer_name = str(layer)
    layer_index = ghrhinodoc.fetch_or_create_layer_index(layer_name)
    newids = list()
    
    for guid, gobj in zip(guids, gobjs):
        # Look up the object to delete.  Convert from a string to a Guid object, then search the active document.
        guid = System.Guid(guid)
        existing = Rhino.RhinoDoc.ActiveDoc.Objects.Find(guid)
        print "Found RhinoDoc object", existing

        if existing is not None:
            name = existing.Attributes.Name
            print "Existing object has name", name
            # Delete the geometry from the RhinoDoc with the given layer and name.
            Rhino.RhinoDoc.ActiveDoc.Objects.Delete(guid, True)

            # If needed, find the geometry corresponding with the given input, possibly looking it up by GUID.
            item = ghrhinodoc.find_ghdoc_geometry(ghdoc, gobj)
            print "Input item is ", item, type(item)

            # Add the geometry to the RhinoDoc with the given layer and name.
            newids.append(str(ghrhinodoc.add_geometry(item, layer_index, name)))
            
        else:
            # if something goes wrong, make sure the output indicates a null for this object
            newids.append(None)
# ---------- end replacegeometry ----------
addgeometry = PythonScript(layer="Cards", gobjs=orient_5.Geometry, names=gesturelogic.names, enabled=gesturelogic.add)  # -> out, guids; inputs gobjs: list, names: list
# ---------- addgeometry: Python ----------
# AddGeometry.py - contents of the AddGeometry ghpython script

# inputs
#   layer  - string naming the layer to address within the current Rhino document
#   gobjs  - list of geometry objects to add, either a raw Geometry type or a ghdoc GUID
#   names  - list of object name strings
# enabled  - Boolean to indicate the action is enabled
#
# Note: gobjs and names must be set to 'List Access'
#
# outputs
#   out    - console debugging output
#   guids  - list of GUID strings for the new geometry primitive
#
# Note: the GUIDs are for objects located in the RhinoDoc database, *not* the
# Grasshopper document database, so they are only useful for requesting updates
# to the current Rhino document.

import Rhino
import System.Guid
import pythonlibpath; pythonlibpath.add_library_path()
import ghutil.ghrhinodoc as ghrhinodoc

# Fetch the layer index, creating the layer if not present.
if enabled:
    layer_name = str(layer)
    layer_index = ghrhinodoc.fetch_or_create_layer_index(layer_name)
    guids = list()
    
    for gobj, name in zip(gobjs, names):
        # If needed, find the geometry corresponding with the given input, possibly looking it up by GUID.
        item = ghrhinodoc.find_ghdoc_geometry(ghdoc, gobj)

        # Add the geometry to the RhinoDoc with the given layer and name, returning the new RhinoDoc GUID as a string.
        guids.append(str(ghrhinodoc.add_geometry(item, layer_index, name)))
# ---------- end addgeometry ----------
preview_3 = CustomPreview(Geometry=orient_5.Geometry, Shader=col_3)
preview_4 = CustomPreview(Geometry=transform, Shader=col_4)
panel_24 = Panel(addgeometry.guids)
panel_25 = Panel(addgeometry.out)
panel_26 = Panel(replacegeometry.newids)
panel_27 = Panel(replacegeometry.out)

filter_4 = StreamFilter(Gate=edit_mode, Stream2=detectflick.sample)
null = NullItem(Item=filter_4)  # -> NullFlags, InvalidFlags, Description
not = GateNot(A=null.NullFlags)
or = GateOr(A=set_selection, B=not)
panel_28 = Panel(not)
layergeometry = PythonScript(layer="Cards", update=set_selection)  # -> out, geoms, guids, names
# ---------- layergeometry: Python ----------
# LayerGeometry.py - contents of the LayerGeometry ghpython script

# inputs
#   layer  - string naming the layer to address within the current Rhino document
#  update  - any input will force recomputing the output (dummy value)

# outputs
#   out     - console debugging output
#   geoms   - list of geometry primitives currently present in the layer
#   guids   - list of GUID strings for the geometry primitives
#   names   - list of user-visible object names

# Note: the GUIDs are for objects located in the RhinoDoc database, *not* the
# Grasshopper document database, so they are only useful for requesting updates
# to the current Rhino document.

import Rhino
import System.Guid
import pythonlibpath; pythonlibpath.add_library_path()
import ghutil.ghrhinodoc as ghrhinodoc

# Fetch the layer index, creating the layer if not present.
layer_name = str(layer)
layer_index = ghrhinodoc.fetch_or_create_layer_index(layer_name)

# Fetch all objects on the layer and report out individual properties.
all_objects = ghrhinodoc.all_doc_objects(layer_name)

geoms = [obj.Geometry for obj in all_objects]
guids = [str(obj.Id) for obj in all_objects]
names = [obj.Attributes.Name for obj in all_objects]

import time
print "Updated at ", time.time()
# ---------- end layergeometry ----------
panel_29 = Panel(layergeometry.geoms)
panel_30 = Panel(layergeometry.out)
panel_31 = Panel(layergeometry.guids)
panel_32 = Panel(layergeometry.names)
panel_33 = Panel(gesturelogic.newloc)
panel_34 = Panel(gesturelogic.names)
panel_35 = Panel("""Mode 1: create
Mode 3: drag""")
panel_37 = Panel(gesturelogic.xform)
