# Grasshopper definition MocapDemo.gh (Grasshopper 0.9.76)
# plug-ins: Python Interpreter

# ----
# Mocap Stream Receiver
# Construct coordinate axes for each object
# from the origin point and  unit basis vectors.
# 
# Note that these have been rotated from
# Optitrack XZ ground plane conventions to
# Rhino XY ground plane conventions.
timer = Timer(TimerInterval=20, Target=python)
python = PythonScript(reset=Toggle(False), version="2900")  # -> out, received, position, orient, xaxis, yaxis; inputs reset: Boolean
# ---------- python: Python ----------
# demo_receiver.py - the motion capture script in the ghpython object in MocapDemo.gh
#
# Demonstration of receiving and parsing an Optitrack motion capture real-time stream.
# This is normally polled from a timer.
#
# inputs
#   reset   - Boolean flag to reset the receiver system
#   version - string defining the protocol version number (e.g. "2900" for Motive 1.9)
#
# outputs
#   out      - debugging text stream
#   received - flag true if new data was received
#   position - data tree of position tuples
#   orient   - data tree of quaternion tuples, orientations are (x,y,z,w) quaternions
#   xaxis    - data tree of X axis unit vectors (computed from orientations)
#   yaxis    - data tree of Y axis unit vectors (computed from orientations)

# use persistent state context
import scriptcontext

# import the Optitrack stream receiver
import optirecv

# If the user reset input is set, then clear any existing state and do nothing.
if reset:
    print "Resetting receiver state."
    scriptcontext.sticky['mocap_port'] = None
 
else:
   # fetch or create the persistent motion capture streaming receiver port
    port = scriptcontext.sticky.get('mocap_port')
    if port is None:
        port = optirecv.OptitrackReceiver(version)
        scriptcontext.sticky['mocap_port'] = port
    
    received = True
    while received:
        received = port.poll()
        
    # always set the output variables so the most recent values are available
    position, orient, xaxis, yaxis = port.make_data_trees()
# ---------- end python ----------
panel = Panel(python.out)
panel_2 = Panel(python.received)
pt = Point(python.yaxis)
pt_2 = Point(python.xaxis)
pt_3 = Point(python.position)
bool = Boolean(python.received)
addition = Addition(A=pt_3, B=pt_2)
addition_2 = Addition(A=pt_3, B=pt)
panel_3 = Panel(python.position)
ln = Line(StartPoint=pt_3, EndPoint=addition)
ln_2 = Line(StartPoint=pt_3, EndPoint=addition_2)

path = FilePath("C:\Users\JBard\Google Drive\CMU\Teaching\16Spring\48-530_HMV\HMV-S16\HMV-S16 Public Files\MocapDemo\Take 2016-01-19 12.25.04 AM.csv")
panel_4 = Panel(path)
mocap_csv_parser = CSV(path=panel_4)  # -> names, x_axis, y_axis
mocap_csv_parser_2 = CSV()  # -> names, x_axis, y_axis
crv = Curve(mocap_csv_parser.y_axis)
crv_2 = Curve(mocap_csv_parser.x_axis)
panel_5 = Panel(mocap_csv_parser.names)

# ==== cluster CSV
# Mocap CSV File Loader
# Note: the Mocap CSV loader rotates
# the input data from the XZ ground plane
# convention of the Optitrack system
# to a XY Rhino ground plane convention.
path = ClusterInput()
python = PythonScript(path=path)  # -> out, names, position, xaxis, yaxis
# ---------- python: Python ----------
# demo_reader.py - the file loader script in the ghpython object in MocapDemo.gh.

# Demonstration of parsing an Optitrack motion capture CSV file.
#
# inputs
#   path    - string with the full path to the CSV file
#
# outputs
#   out      - debugging text stream
#   names    - data tree of body names
#   position - data tree of position tuples
#   xaxis    - data tree of X axis unit vectors (computed from orientations)
#   yaxis    - data tree of Y axis unit vectors (computed from orientations)


# import the Optitrack file loader from the same folder
import optiload

# load the file
take = optiload.load_csv_file(path)

print "Found rigid bodies:", take.rigid_bodies.keys()

# emit all return values
names = take.rigid_bodies.keys()
position, xaxis, yaxis = optiload.make_data_trees(take)
# ---------- end python ----------
# Length of axes
number_slider = Slider(0.2, range=0..1)
panel = Panel(python.out)
panel_2 = Panel(python.names)
panel_3 = Panel(python.yaxis)
panel_4 = Panel(python.xaxis)
multiplication = Multiplication(A=python.xaxis, B=number_slider)
multiplication_2 = Multiplication(A=python.yaxis, B=number_slider)
panel_5 = Panel(python.position)
addition = Addition(A=python.position, B=multiplication_2)
addition_2 = Addition(A=python.position, B=multiplication)
pt = Point(python.position)
ln = Line(StartPoint=pt, EndPoint=addition_2)
ln_2 = Line(StartPoint=pt, EndPoint=addition)
names = ClusterOutput(python.names)
y_axis = ClusterOutput(ln_2)
x_axis = ClusterOutput(ln)
