# Grasshopper definition generate-card-set.gh (Grasshopper 0.9.76)
# plug-ins: Python Interpreter

# ----
# Tools to recreate the initial set of cards.
# destination layer name
# single card exemplar
# initial position axis
# number of cards
# naming convention
write_cards_to_document = Button()
srf = Surface(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)
crv = Curve(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)
subtraction = Subtraction(A="52", B=1)
dom = ConstructDomain(DomainStart=1, DomainEnd="52")
range = Range(Domain=dom, Steps=subtraction)
divide = DivideCurve(Curve=crv, Count=subtraction, Kinks=False)  # -> Points, Tangents, Parameters
format = Format(Format="{0}", Culture=127, Data0=range)
move = Move(Geometry=srf, Motion=divide.Points)  # -> Geometry, Transform
addgeometry = PythonScript(layer="Cards", gobjs=move.Geometry, names=format, enabled=write_cards_to_document)  # -> out, guids; inputs gobjs: list, names: list
# ---------- addgeometry: Python ----------
# AddGeometry.py - contents of the AddGeometry ghpython script

# inputs
#   layer  - string naming the layer to address within the current Rhino document
#   gobjs  - list of geometry objects to add, either a raw Geometry type or a ghdoc GUID
#   names  - list of object name strings
# enabled  - Boolean to indicate the action is enabled
#
# Note: gobjs and names must be set to 'List Access'
#
# outputs
#   out    - console debugging output
#   guids  - list of GUID strings for the new geometry primitive
#
# Note: the GUIDs are for objects located in the RhinoDoc database, *not* the
# Grasshopper document database, so they are only useful for requesting updates
# to the current Rhino document.

import Rhino
import System.Guid
import pythonlibpath; pythonlibpath.add_library_path()
import ghutil.ghrhinodoc as ghrhinodoc

# Fetch the layer index, creating the layer if not present.
if enabled:
    layer_name = str(layer)
    layer_index = ghrhinodoc.fetch_or_create_layer_index(layer_name)
    guids = list()
    
    for gobj, name in zip(gobjs, names):
        # If needed, find the geometry corresponding with the given input, possibly looking it up by GUID.
        item = ghrhinodoc.find_ghdoc_geometry(ghdoc, gobj)

        # Add the geometry to the RhinoDoc with the given layer and name, returning the new RhinoDoc GUID as a string.
        guids.append(str(ghrhinodoc.add_geometry(item, layer_index, name)))
# ---------- end addgeometry ----------
panel = Panel(addgeometry.out)
panel_2 = Panel(addgeometry.guids)
