# Grasshopper definition RhinoDocDemo.gh (Grasshopper 0.9.76)
# plug-ins: Python Interpreter

button = Button()
crv = Curve(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)
# GUIDs are for the Rhino ActiveDoc,
# not Grasshopper ghdoc
layergeometry = PythonScript(layer="Cards", update=Button())  # -> out, geom, guid
# ---------- layergeometry: Python ----------
# LayerGeometry.py - contents of the LayerGeometry ghpython script

# inputs
#   layer  - string naming the layer to address within the current Rhino document
#  update  - any input will force recomputing the output (dummy value)

# outputs
#   out    - console debugging output
#   geom   - list of geometry primitives currently present in the layer
#   guid   - list of GUID strings for the geometry primitives
#
# Note: the GUIDs are for objects located in the RhinoDoc database, *not* the
# Grasshopper document database, so they are only useful for requesting updates
# to the current Rhino document.

import Rhino
import System.Guid
import pythonlibpath; pythonlibpath.add_library_path()
import ghutil.ghrhinodoc as ghrhinodoc

# Fetch the layer index, creating the layer if not present.
layer_name = str(layer)
layer_index = ghrhinodoc.fetch_or_create_layer_index(layer_name)

# Fetch all objects on the layer and report out individual properties.
all_objects = ghrhinodoc.all_doc_objects(layer_name)

geom = [obj.Geometry for obj in all_objects]
guid = [str(obj.Id) for obj in all_objects]
# ---------- end layergeometry ----------
addgeometry = PythonScript(layer="Cards", name="Swoop")  # -> out, guid
# ---------- addgeometry: Python ----------
# AddGeometry.py - contents of the AddGeometry ghpython script

# inputs
#   layer  - string naming the layer to address within the current Rhino document
#   gobj   - geometry object to add, either a raw Geometry type or a ghdoc GUID
#   name   - object name string
#  update  - dummy input to force adding again

# outputs
#   out    - console debugging output
#   guid   - GUID strings for the new geometry primitive
#
# Note: the GUIDs are for objects located in the RhinoDoc database, *not* the
# Grasshopper document database, so they are only useful for requesting updates
# to the current Rhino document.

import Rhino
import System.Guid
import pythonlibpath; pythonlibpath.add_library_path()
import ghutil.ghrhinodoc as ghrhinodoc

# Fetch the layer index, creating the layer if not present.
layer_name = str(layer)
layer_index = ghrhinodoc.fetch_or_create_layer_index(layer_name)

# If needed, find the geometry corresponding with the given input, possibly looking it up by GUID.
item = ghrhinodoc.find_ghdoc_geometry(ghdoc, gobj)
print "Input item is ", item, type(item)

# Add the geometry to the RhinoDoc with the given layer and name.
guid = str(ghrhinodoc.add_geometry(item, layer_index, name))
# ---------- end addgeometry ----------
panel = Panel(addgeometry.guid)
deletegeometry = PythonScript(layer="Cards")  # -> out
# ---------- deletegeometry: Python ----------
# DeleteGeometry.py - contents of the DeleteGeometry ghpython script

# inputs
#   layer  - string naming the layer to address within the current Rhino document
#   guid   - GUID string identifying a single object within the RhinoDoc

# outputs
#   out    - console debugging output
#
# Note: the GUIDs are for objects located in the RhinoDoc database, *not* the
# Grasshopper document database, so they are only useful for requesting updates
# to the current Rhino document.

import Rhino
import System.Guid
import pythonlibpath; pythonlibpath.add_library_path()
import ghutil.ghrhinodoc as ghrhinodoc

if guid is not None:
    # Fetch the layer index, creating the layer if not present.
    layer_name = str(layer)
    layer_index = ghrhinodoc.fetch_or_create_layer_index(layer_name)
    
    # Look up the object to delete.
    print "GUID to modify is", guid, type(guid)
    
    # convert from a string to a Guid object
    guid = System.Guid(guid)
    
    existing = Rhino.RhinoDoc.ActiveDoc.Objects.Find(guid)
    print "Found RhinoDoc object", existing
    
    # Delete the geometry from the RhinoDoc with the given layer and name.
    Rhino.RhinoDoc.ActiveDoc.Objects.Delete(guid, True)
# ---------- end deletegeometry ----------

# ----
# Tools to recreate the initial set of cards.
panel_2 = Panel("starting")
crv_2 = Curve(<curve referenced from the Rhino model>)
layergeometry_2 = PythonScript(layer=panel_2, update=Button())  # -> out, geom, guid; same code as layergeometry
srf = Surface(<surface referenced from the Rhino model>)
divide = DivideCurve(Curve=crv_2, Count="52", Kinks=False)  # -> Points, Tangents, Parameters
panel_3 = Panel(layergeometry_2.geom)
move = Move(Geometry=srf, Motion=divide.Points)  # -> Geometry, Transform
addgeometry_2 = PythonScript(layer="Cards", name="card", update=Button())  # -> out, guid; same code as addgeometry

geo = Geometry(layergeometry.geom)
panel_4 = Panel(layergeometry.out)
panel_5 = Panel(layergeometry.geom)
panel_6 = Panel(addgeometry.out)
panel_7 = Panel(layergeometry.guid)
panel_9 = Panel(deletegeometry)
item = ListItem(List=layergeometry.guid, Index=0, Wrap=True)
panel_10 = Panel(item)
selectedgeometry = PythonScript(layer="Cards", update=Button())  # -> out, geom, guid
# ---------- selectedgeometry: Python ----------
# SelectedGeometry.py - contents of the SelectedGeometry ghpython script

# inputs
#   layer  - string naming the layer to address within the current Rhino document
#  update  - any input will force recomputing the output (dummy value)

# outputs
#   out    - console debugging output
#   geom   - list of geometry primitives currently selected in the layer
#   guid   - list of GUID strings for the geometry primitives
#
# Note: the GUIDs are for objects located in the RhinoDoc database, *not* the
# Grasshopper document database, so they are only useful for requesting updates
# to the current Rhino document.

import Rhino
import System.Guid
import pythonlibpath; pythonlibpath.add_library_path()
import ghutil.ghrhinodoc as ghrhinodoc

# Fetch the layer index, creating the layer if not present.
layer_name = str(layer)
layer_index = ghrhinodoc.fetch_or_create_layer_index(layer_name)

# Fetch all objects on the layer, choose the selected ones,  and report out individual properties.
# See the definition of RhinoObject.IsSelected; if the argument is true then it also reports on sub-objects.
all_objects = ghrhinodoc.all_doc_objects(layer_name)
selected_objects = [obj for obj in all_objects if obj.IsSelected(False) > 0] 

print "Found %d objects in layer, %d are selected." % (len(all_objects), len(selected_objects))

geom = [obj.Geometry for obj in selected_objects]
guid = [str(obj.Id) for obj in selected_objects]
# ---------- end selectedgeometry ----------
srf_2 = Surface(selectedgeometry.geom)
vec = VectorXYZ(XComponent=Slider(0.263, range=0..1), YComponent=0, ZComponent=0)  # -> Vector, Length
panel_11 = Panel(selectedgeometry.geom)
move_2 = Move(Geometry=srf_2, Motion=vec.Vector)  # -> Geometry, Transform
panel_12 = Panel(selectedgeometry.guid)
delete_selection = Button()
update = Button()
replacegeometry = PythonScript(layer="Cards", update=update, guid=selectedgeometry.guid, gobj=move_2.Geometry)  # -> out, newid
# ---------- replacegeometry: Python ----------
# ReplaceGeometry.py - contents of the ReplaceGeometry ghpython script

# inputs
#   layer  - string naming the layer to address within the current Rhino document
#  update  - Boolean indicating the action is enabled
#   guid   - GUID string identifying a single object within the RhinoDoc to replace
#   gobj   - geometry object to add, either a raw Geometry type or a ghdoc GUID

# outputs
#   out    - console debugging output
#  newid   - GUID strings for the new geometry primitive
# Note: the GUIDs are for objects located in the RhinoDoc database, *not* the
# Grasshopper document database, so they are only useful for requesting updates
# to the current Rhino document.

import Rhino
import System.Guid
import pythonlibpath; pythonlibpath.add_library_path()
import ghutil.ghrhinodoc as ghrhinodoc

if update and guid is not None:
    # Fetch the layer index, creating the layer if not present.
    layer_name = str(layer)
    layer_index = ghrhinodoc.fetch_or_create_layer_index(layer_name)
    
    # Look up the object to delete.
    print "GUID to modify is", guid, type(guid)
    
    # convert from a string to a Guid object
    guid = System.Guid(guid)
    
    existing = Rhino.RhinoDoc.ActiveDoc.Objects.Find(guid)
    print "Found RhinoDoc object", existing
    if existing is not None:
        name = existing.Attributes.Name
        print "Existing object has name", name
        # Delete the geometry from the RhinoDoc with the given layer and name.
        Rhino.RhinoDoc.ActiveDoc.Objects.Delete(guid, True)

        # If needed, find the geometry corresponding with the given input, possibly looking it up by GUID.
        item = ghrhinodoc.find_ghdoc_geometry(ghdoc, gobj)
        print "Input item is ", item, type(item)

        # Add the geometry to the RhinoDoc with the given layer and name.
        newid = str(ghrhinodoc.add_geometry(item, layer_index, name))
# ---------- end replacegeometry ----------
# GUIDs are for the Rhino ActiveDoc,
# not Grasshopper ghdoc
selectedgeometry_2 = PythonScript(layer="Cards", update=delete_selection)  # -> out, geom, guid; same code as selectedgeometry
panel_13 = Panel(replacegeometry.newid)
panel_14 = Panel(replacegeometry.out)
deletegeometry_2 = PythonScript(layer="Cards")  # -> out; same code as deletegeometry
geo_2 = Geometry(selectedgeometry_2.geom)
panel_15 = Panel(selectedgeometry_2.out)
panel_16 = Panel(selectedgeometry_2.geom)
panel_17 = Panel(selectedgeometry_2.guid)
